# Grasshopper definition Ladybug-und-Honeybee_Beispiele.gh (Grasshopper 1.0.7)
# plug-ins: Pufferfish, Human, Bifocals, Palette

palette = Palette(
    ModeCustomStandard=Toggle(True),
    Component_Normal_Deselected_Fill_Color=RGB(200, 200, 200),
    Component_Normal_Deselected_Edge_Color=RGB(50, 50, 50),
    Component_Normal_Deselected_Text_Color=RGB(0, 0, 0),
    Component_Normal_Selected_Fill_Color=RGB(130, 215, 50),
    Component_Normal_Selected_Edge_Color=RGB(0, 50, 0),
    Component_Normal_Selected_Text_Color=RGB(0, 25, 0),
    Component_Hidden_Deselected_Fill_Color=RGB(140, 140, 155),
    Component_Hidden_Deselected_Edge_Color=RGB(35, 35, 35),
    Component_Hidden_Deselected_Text_Color=RGB(0, 0, 0),
    Component_Hidden_Selected_Fill_Color=RGB(80, 180, 10),
    Component_Hidden_Selected_Edge_Color=RGB(0, 35, 0),
    Component_Hidden_Selected_Text_Color=RGB(0, 25, 0),
    Component_Disabled_Deselected_Fill_Color=RGB(120, 120, 120),
    Component_Disabled_Deselected_Edge_Color=RGB(90, 90, 90),
    Component_Disabled_Deselected_Text_Color=RGB(70, 70, 70),
    Component_Disabled_Selected_Fill_Color=RGB(110, 150, 115),
    Component_Disabled_Selected_Edge_Color=RGB(40, 70, 40),
    Component_Disabled_Selected_Text_Color=RGB(75, 100, 65),
    Component_Warning_Deselected_Fill_Color=RGB(255, 140, 20),
    Component_Warning_Deselected_Edge_Color=RGB(80, 10, 0),
    Component_Warning_Deselected_Text_Color=RGB(0, 0, 0),
    Component_Warning_Selected_Fill_Color=RGB(185, 205, 0),
    Component_Warning_Selected_Edge_Color=RGB(0, 50, 0),
    Component_Warning_Selected_Text_Color=RGB(0, 0, 0),
    Component_Error_Deselected_Fill_Color=RGB(200, 0, 0),
    Component_Error_Deselected_Edge_Color=RGB(60, 0, 0),
    Component_Error_Deselected_Text_Color=RGB(0, 0, 0),
    Component_Error_Selected_Fill_Color=RGB(125, 155, 0),
    Component_Error_Selected_Edge_Color=RGB(0, 50, 0),
    Component_Error_Selected_Text_Color=RGB(255, 255, 255),
    Component_Label_Deselected_Fill_Color=RGB(50, 50, 50),
    Component_Label_Deselected_Edge_Color=RGB(0, 0, 0),
    Component_Label_Deselected_Text_Color=RGB(255, 255, 255),
    Component_Label_Selected_Fill_Color=RGB(25, 60, 25),
    Component_Label_Selected_Edge_Color=RGB(0, 35, 0),
    Component_Label_Selected_Text_Color=RGB(190, 250, 180),
    Galapagos_Deselected_Fill_Color=RGB(255, 0, 125),
    Galapagos_Deselected_Edge_Color=RGB(100, 0, 50),
    Galapagos_Selected_Fill_Color=RGB(160, 210, 30),
    Galapagos_Selected_Edge_Color=RGB(0, 50, 0),
    Wire_Normal_Color=ColourSwatch(SwatchColor=RGB(0, 0, 0)),
    Wire_Empty_Color=RGBA(255, 60, 0, 180),
    Wire_Selected_Start_Color=RGB(125, 210, 40),
    Wire_Selected_End_Color=RGBA(0, 0, 0, 50),
    Panel_Default_Color=RGB(255, 250, 90),
    Group_Default_Color=RGBA(170, 135, 225, 150),
    Canvas_Background_Color=ColourSwatch(SwatchColor=RGB(255, 255, 255)),
    Canvas_Gridline_Color=ColourSwatch(SwatchColor=RGB(255, 255, 255)),
    Canvas_Gridline_Width=150,
    Canvas_Gridline_Height=50,
    Canvas_Edge_Color=RGB(0, 0, 0),
    Canvas_Shadow_Color=RGBA(0, 0, 0, 80),
    Canvas_Shadow_Size=30,
    MonochromaticOnOff=False,
    Monochromatic_Color=RGB(212, 208, 200))

ladybug = Ladybug_Ladybug()  # -> out; plug-in component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
panel = Panel(ladybug)
updateghfile = Ladybug_UpdateFile(update=Toggle(False))  # -> readMe; plug-in component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

# ----
# Verbindungen
# Rechtsklick: WireDisplay = Default
# Rechtsklick: WireDisplay = Faint
# Rechtsklick: WireDisplay = Hidden
# Wenn mehrer Informationen
# aus einer Liste übertragen
# werden
# Wenn mehrere Informationen aus
# unterschiedlichen Listen übertragen
# werden
panel_2 = Panel("""Daten 1
Daten 2""")
panel_3 = Panel("""Daten 1
Daten 2""")
graft_tree = GraftTree(Tree=panel_2, IncludeEmptyLists=True, IncludeNullItems=True)
panel_4 = Panel(graft_tree)
data = Data("1")
data_2 = Data("1")
data_3 = Data("1")
data_4 = Data(panel_3)
data_5 = Data(panel_4)

# ----
# Preview Geomtrie (oben rechts)
# 
# 
# 
# 
# 
# 
# 
# 
# 
# 1. Keine Geomtrien previewn
# 2. Wireframe Darstellung
# 3. Schattierte Darstellung
# |
# 4. Nur gewählte Objekte zeigen
# 5. Einstellung Farben
# 6. Qualitäts Einstellungen
image_sampler = ImageSampler(
    FilePath="D:\00_OneDrive\OneDrive\Dokumente\ShareX\Screenshots\2021-05\Rhino_ZAKrz55Dlj.png",
    Filter="Colour",
    Interpolate=False,
    Umax=1,
    Umin=0,
    Vmax=1,
    Vmin=0,
    Wrap=1)

# ----
# Objektdefinitionen
point = Point(Point(-2, -1, 0))
vector = Vector(Vector(0, 40, 0))
brep = Brep(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)
panel_5 = Panel(point)
panel_6 = Panel(vector)
panel_7 = Panel(brep)

# ----
# Gradient Bibliothek
panel_8 = Panel("1")
gradientlibrary = Ladybug_GradientLibrary(gradIndex=panel_8)  # -> customColors; plug-in component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
legendpar = Ladybug_LegendParameters(customColors=flatten(gradientlibrary))  # -> legendPar; plug-in component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

# ----
# Analysis Period
# Von: (Monat, Tag, Zeit)
# Bis: (Monat, Tag, Zeit)
panel_9 = Panel("5")
analysisperiod = Ladybug_AnalysisPeriod(fromMonth=panel_9, toMonth="8")  # -> out, analysisPeriod; plug-in component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
panel_10 = Panel(analysisperiod.analysisPeriod)

activitieslist = Ladybug_ActivitiesMetList({"Sleeping": 0.7, "Reclining": 0.8, "Sitting": 1.0, "Typing": 1.1, "Standing": 1.2, "Driving": 1.5, "Cooking": 1.8, "House Cleaning": 2.7, "Strolling": 1.7, "Walking 2mph": 2.0, "Walking 3mph": 2.6, "Walking 4mph": 3.8, "Running 9mph": 9.5, "Lifting 10lbs": 2.1, "Lifting 100lbs": 4.0, "Shoveling": 4.4, "Dancing": 3.4, "Basketball": 6.3}, selected="Sitting")
clothin_level = Panel("0.3")

point_2 = Point(Point(93, 81, 0))
point_3 = Point(Point(206, -2, 0))
point_4 = Point(Point(206, 17, 0))
point_5 = Point(Point(166, 80, 0))

series = Series(Start=0, Step="0.1", Count=10)
gradient = Gradient(LowerLimit=0, UpperLimit=1, Parameter=series, stops=[0: RGB(130, 222, 255), 0.32: RGB(255, 245, 110), 1: RGB(255, 0, 0)])
legendpar_2 = Ladybug_LegendParameters(lowBound="0", highBound=Slider(1000, range=0..10000), numSegments="11", customColors=flatten(gradient))  # -> legendPar; plug-in component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

callfromepconstrlibrary = Honeybee_CallFromEPConstructionLibrary()  # -> ThermMaterials, EPMaterials, EPWindowMaterials, EPConstructions; plug-in component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

honeybee = Honeybee_Honeybee()  # -> out; plug-in component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
updatehoneybee = Honeybee_UpdateHoneybee()  # -> out; plug-in component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
panel_11 = Panel(honeybee)

searchepconstruction = Honeybee_SearchEPConstruction(EPConstrList=callfromepconstrlibrary.EPConstructions, standard="2")  # -> EPSelectedConstr; plug-in component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
item_selector = ItemSelector(
    searchepconstruction,
    {"ASHRAE 90.1-2010 ATTICFLOOR CLIMATEZONE 1", "ASHRAE 90.1-2010 ATTICFLOOR CLIMATEZONE 1-2 SEMIHEATED", "ASHRAE 90.1-2010 ATTICFLOOR CLIMATEZONE 2-7", "ASHRAE 90.1-2010 ATTICFLOOR CLIMATEZONE 3-5 SEMIHEATED", "ASHRAE 90.1-2010 ATTICFLOOR CLIMATEZONE 6-8 SEMIHEATED", "ASHRAE 90.1-2010 ATTICFLOOR CLIMATEZONE 8"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}, selected="ASHRAE 90.1-2010 EXTWALL MASS CLIMATEZONE 7 SEMIHEATED")
item_selector_2 = ItemSelector(
    searchepconstruction,
    {"ASHRAE 90.1-2010 ATTICFLOOR CLIMATEZONE 1", "ASHRAE 90.1-2010 ATTICFLOOR CLIMATEZONE 1-2 SEMIHEATED", "ASHRAE 90.1-2010 ATTICFLOOR CLIMATEZONE 2-7", "ASHRAE 90.1-2010 ATTICFLOOR CLIMATEZONE 3-5 SEMIHEATED", "ASHRAE 90.1-2010 ATTICFLOOR CLIMATEZONE 6-8 SEMIHEATED", "ASHRAE 90.1-2010 ATTICFLOOR CLIMATEZONE 8"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}, selected="ASHRAE 90.1-2010 EXTWALL WOODFRAME CLIMATEZONE 6-7")
wall = Panel("0")
wall_2 = Panel("0")
brep_2 = Brep(<brep referenced from the Rhino model>)
brep_3 = Brep(<brep referenced from the Rhino model>)
honeybee_bldgprograms = Honeybee_bldgPrograms({"Office": 0, "Retail": 1, "MidriseApartment": 2, "PrimarySchool": 3, "SecondarySchool": 4, "SmallHotel": 5, "LargeHotel": 6, "Hospital": 7, "Outpatient": 8, "Warehouse": 9, "SuperMarket": 10, "FullServiceRestaurant": 11, "QuickServiceRestaurant": 12}, selected="Office")
createhbsrfs = Honeybee_createHBSrfs(geometry=brep_2, srfType=wall, EPBC="Adiabatic", EPConstruction=item_selector_2)  # -> out, simplify(HBSurface); plug-in component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
createhbsrfs_2 = Honeybee_createHBSrfs(geometry=brep_3, srfType=wall_2, EPBC="Adiabatic", EPConstruction=item_selector_2)  # -> out, simplify(HBSurface); plug-in component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
listzoneprograms = Honeybee_ListZonePrograms(bldgProgram=honeybee_bldgprograms)  # -> OfficeZonePrograms; plug-in component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
item_selector_3 = ItemSelector(
    listzoneprograms,
    {"Office::BreakRoom", "Office::Storage", "Office::Vending", "Office::OpenOffice", "Office::ClosedOffice", "Office::Conference", "Office::PrintRoom", "Office::Restroom", "Office::Elec/MechRoom", "Office::IT_Room", "Office::Stair", "Office::Corridor", "Office::Lobby"}, selected="Office::OpenOffice")
boolean_toggle = BooleanToggle(False)

# ----
# Zone 01
underground_slap = Panel("2.25")
roof = Panel("1")
wall_3 = Panel("0")
brep_4 = Brep(<brep referenced from the Rhino model>)
brep_5 = Brep([<brep referenced from the Rhino model> x3])
brep_6 = Brep(<brep referenced from the Rhino model>)
createhbsrfs_3 = Honeybee_createHBSrfs(geometry=brep_6, srfType=underground_slap, EPBC="Ground")  # -> out, simplify(HBSurface); plug-in component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
createhbsrfs_4 = Honeybee_createHBSrfs(geometry=brep_4, srfType=roof, EPBC="Outdoors")  # -> out, simplify(HBSurface); plug-in component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
createhbsrfs_5 = Honeybee_createHBSrfs(geometry=brep_5, srfType=wall_3, EPBC="Outdoors")  # -> out, simplify(HBSurface); plug-in component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
brep_7 = Brep(<brep referenced from the Rhino model>)
addhbglz = Honeybee_addHBGlz(HBObj=createhbsrfs_5.HBSurface, childSurfaces=flatten(brep_7))  # -> HBObjWGLZ; plug-in component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
createhbzones = Honeybee_createHBZones(
    name="Zone 01",
    zoneProgram=item_selector_3,
    HBSurfaces=flatten([addhbglz, createhbsrfs_4.HBSurface, createhbsrfs_3.HBSurface, createhbsrfs_2.HBSurface]),
    isConditioned=boolean_toggle)  # -> out, HBZone; plug-in component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

# ----
# Zone 02
underground_slap_2 = Panel("2.25")
wall_4 = Panel("0")
roof_2 = Panel("1")
brep_8 = Brep([<brep referenced from the Rhino model> x3])
brep_9 = Brep(<brep referenced from the Rhino model>)
brep_10 = Brep(<brep referenced from the Rhino model>)
createhbsrfs_6 = Honeybee_createHBSrfs(geometry=brep_10, srfType=underground_slap_2, EPBC="Ground")  # -> out, simplify(HBSurface); plug-in component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
createhbsrfs_7 = Honeybee_createHBSrfs(geometry=brep_8, srfType=wall_4, EPBC="Outdoors", EPConstruction=item_selector)  # -> out, simplify(HBSurface); plug-in component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
createhbsrfs_8 = Honeybee_createHBSrfs(geometry=brep_9, srfType=roof_2, EPBC="Outdoors")  # -> out, simplify(HBSurface); plug-in component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
brep_11 = Brep(<brep referenced from the Rhino model>)
addhbglz_2 = Honeybee_addHBGlz(HBObj=createhbsrfs_7.HBSurface, childSurfaces=flatten(brep_11))  # -> HBObjWGLZ; plug-in component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
createhbzones_2 = Honeybee_createHBZones(
    name="Zone 02",
    zoneProgram=item_selector_3,
    HBSurfaces=flatten([addhbglz_2, createhbsrfs_8.HBSurface, createhbsrfs_6.HBSurface, createhbsrfs.HBSurface]),
    isConditioned=boolean_toggle)  # -> out, HBZone; plug-in component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

# ----
# 1. ZONEN ZUSAMMENFÜHREN
boolean_toggle_2 = BooleanToggle(True)
solveadjc = Honeybee_SolveAdjacencies(
    HBZones=flatten([createhbzones.HBZone, createhbzones_2.HBZone]),
    removeCurrentAdjc=False,
    preserveConstr=boolean_toggle_2,
    findAdjc=boolean_toggle_2)  # -> out, HBZonesWADJ; plug-in component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
überprüfung = Panel(solveadjc.HBZonesWADJ)

# ----
# Konstruktione/Materialien aus Bilbiotheken abrufen
callfromepconstrlibrary_2 = Honeybee_CallFromEPConstructionLibrary()  # -> ThermMaterials, EPMaterials, EPWindowMaterials, EPConstructions; plug-in component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
searchepconstruction_2 = Honeybee_SearchEPConstruction(EPConstrList=callfromepconstrlibrary_2.EPConstructions, standard="2")  # -> EPSelectedConstr; plug-in component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
item_selector_4 = ItemSelector(
    callfromepconstrlibrary_2.EPMaterials,
    {"1/2IN GYPSUM", "1IN STUCCO", "8IN CONCRETE HW", "8IN CONCRETE HW REFBLDG", "AIR WALL MATERIAL", "ATTICFLOOR INSULATION"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}, selected="1/2IN GYPSUM")
item_selector_5 = ItemSelector(
    searchepconstruction_2,
    {"ASHRAE 90.1-2010 ATTICFLOOR CLIMATEZONE 1", "ASHRAE 90.1-2010 ATTICFLOOR CLIMATEZONE 1-2 SEMIHEATED", "ASHRAE 90.1-2010 ATTICFLOOR CLIMATEZONE 2-7", "ASHRAE 90.1-2010 ATTICFLOOR CLIMATEZONE 3-5 SEMIHEATED", "ASHRAE 90.1-2010 ATTICFLOOR CLIMATEZONE 6-8 SEMIHEATED", "ASHRAE 90.1-2010 ATTICFLOOR CLIMATEZONE 8"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}, selected="ASHRAE 90.1-2010 EXTWALL MASS CLIMATEZONE 7-8")
panel_12 = Panel(searchepconstruction_2)

# ----
# Verschiedene Möglichkeiten Materialien zu definieren
epshademat = Honeybee_EnergyPlusShadeMaterial()  # -> shadeMaterial; plug-in component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
epopaquemat = Honeybee_EnergyPlusOpaqueMaterial()  # -> EPMaterial; plug-in component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
epwindowairgap = Honeybee_EnergyPlusWindowAirGap()  # -> EPMaterial; plug-in component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
epnomassmat = Honeybee_EnergyPlusNoMassOpaqueMaterial()  # -> EPMaterial; plug-in component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
epwindowmat = Honeybee_EnergyPlusWindowMaterial()  # -> EPMaterial; plug-in component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
epglassmat = Honeybee_EnergyPlusGlassMaterial()  # -> EPMaterial; plug-in component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

# ----
# Mit diesen Komponenten können Materialien und
# Konstruktionen aus der Bibliotheke überprüft werden,
# wenn diese schon zur Bibliotheke hinzugefügt wurden!
panel_13 = Panel("wall")
callfromepconstrlibrary_3 = Honeybee_CallFromEPConstructionLibrary(keywords=panel_13)  # -> ThermMaterials, EPMaterials, EPWindowMaterials, EPConstructions; plug-in component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
list = ItemSelector(
    callfromepconstrlibrary_3.EPMaterials,
    {"AIR WALL MATERIAL", "F04 WALL AIR SPACE RESISTANCE", "MASS NONRES WALL INSULATION-0.43", "MASS NONRES WALL INSULATION-0.52", "MASS NONRES WALL INSULATION-0.61", "MASS NONRES WALL INSULATION-0.77"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}, selected="MASS WALL INSULATION R-10.11 IP")
decomposeepmaterial = Honeybee_DecomposeEPMaterial(materialName=simplify(list))  # -> names, values, comments, UValue_SI, UValue_IP, RValue_SI, RValue_IP; plug-in component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
panel_14 = Panel(decomposeepmaterial.comments)
panel_15 = Panel(decomposeepmaterial.names)
panel_16 = Panel(decomposeepmaterial.values)
decomposeepconstruction = Honeybee_DecomposeEPConstruction()  # -> materials, comments, UValue_SI, UValue_IP, RValue_SI, RValue_IP; plug-in component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

# ----
# Innenliegende Konstruktionen bestimmen
setepzoneintcnstr = Honeybee_SetEPZoneInteriorConstruction(HBZones=solveadjc.HBZonesWADJ)  # -> simplify(modifiedHBZones); plug-in component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

# ----
# Eigenen Konstruktionsaufbau definieren
# (durch nahes zoomen, kann man
# mit den Plus und Minus Zeichen, Elemente entfernen und ergänzen).
# Sie sollte dann immer zur Bibliothek ergänzt
# werden, um es in den Construction Componenten nutzen zu können
list_2 = ItemSelector(
    callfromepconstrlibrary_3.EPMaterials,
    {"AIR WALL MATERIAL", "F04 WALL AIR SPACE RESISTANCE", "MASS NONRES WALL INSULATION-0.43", "MASS NONRES WALL INSULATION-0.52", "MASS NONRES WALL INSULATION-0.61", "MASS NONRES WALL INSULATION-0.77"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}, selected="AIR WALL MATERIAL")
list_3 = ItemSelector(
    callfromepconstrlibrary_3.EPMaterials,
    {"AIR WALL MATERIAL", "F04 WALL AIR SPACE RESISTANCE", "MASS NONRES WALL INSULATION-0.43", "MASS NONRES WALL INSULATION-0.52", "MASS NONRES WALL INSULATION-0.61", "MASS NONRES WALL INSULATION-0.77"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}, selected="MASS WALL INSULATION R-10.11 IP")
list_4 = ItemSelector(
    callfromepconstrlibrary_3.EPMaterials,
    {"AIR WALL MATERIAL", "F04 WALL AIR SPACE RESISTANCE", "MASS NONRES WALL INSULATION-0.43", "MASS NONRES WALL INSULATION-0.52", "MASS NONRES WALL INSULATION-0.61", "MASS NONRES WALL INSULATION-0.77"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}, selected="METAL BUILDING SEMI-COND WALL INSULATION-0.54")
epconstruction = Honeybee_EnergyPlusConstruction(name="testmaterial", layer_1=list_4, layer_2=list_2, layer_3=list_3)  # -> EPConstruction; plug-in component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
boolean_toggle_3 = BooleanToggle(False)
addtoeplibrary = Honeybee_AddToEnergyPlusLibrary(EPObject=epconstruction, addToProjectLib=boolean_toggle_3, overwrite=boolean_toggle_3)  # -> out; plug-in component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

# ----
# Außenliegede Konstruktionen bestimmen
setepzonecnstr = Honeybee_SetEPZoneConstruction(HBZones=flatten(setepzoneintcnstr), wallEPConstruction=item_selector_5)  # -> simplify(modifiedHBZones); plug-in component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

# ----
# Konstruktionen auf Flächen projizieren
honeybee_surface_attribute_list = Honeybee_SurfaceAttributeList({"Name": "name", "Radiance Material": "RadMaterial", "EnergyPlus Construction": "EPConstruction", "Surface Type": "type", "Boundary Condition": "BC", "BC Object": "BCObject", "Sun Exposure": "sunExposure", "Wind Exposure": "windExposure", "Has Child Surface": "hasChild", "Is Child Surface": "isChild", "Is Planar": "isPlanar", "Srf Type Set By User": "srfTypeByUser", "Boundary Condition Set By User": "srfBCByUser", "Shade Material Name": "shadeMaterialName", "Shading Control Name": "shadingControlName", "Shcading Schedule Name": "shadingSchName"}, selected="EnergyPlus Construction")
textgröße = Slider(0.1, range=0..0.1)
labelsurfaces = Honeybee_LabelZoneSurfaces(HBObjects=flatten(setepzonecnstr), attribute=honeybee_surface_attribute_list, textHeight=textgröße)  # -> surfaceTxtLabels, labelBasePts, brepTxtLabels, surfaceWireFrames; plug-in component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

# ----
# 2. KONSTRUKTIONEN UND MATERIALIEN
überprüfung_2 = Panel(setepzonecnstr)

# ----
# 3. LÜFTUNGSZEITEN (SCHEDULES)
# Variante 1:
# Eine Liste von Werten für jede Stunde am
# Tag, wobie 0 angibt, das nicht gelüftet wird
# und 1 angibt, das gelüftet wird.
# Hier als Beispiel:
#  9-18 Uhr an (1)/
# 19-8 Uhr aus (0)
# Variante 2:
# Diese Variante nutzt eine Series Komponente um 8760 Ereignisse zu
# erstellen und um zu definieren, dass immer gelüftet wird.
# immer an -> 1 in 8760h/Jahr
panel_17 = Panel("""0
0
0
0
0
0
0
0
0
1
1
1
1
1
1
1
1
1
1
0
0
0
0
0""")
panel_18 = Panel("1")
repeat = RepeatData(Data=panel_17, Length="8760")
csvschedule = Honeybee_CreateCSVSchedule(values=repeat, scheduleName="Beispiel", writeFile=Toggle(True))  # -> readMe, csvSchedule; plug-in component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
setepzoneschedules = Honeybee_SetEnergyPlusZoneSchedules(HBZones=setepzonecnstr, ventilationSchedules=csvschedule.csvSchedule)  # -> schedules, simplify(HBZones); plug-in component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
überprüfung_3 = Panel(setepzoneschedules.HBZones)

# ----
# Schedule/Zeiten visualisieren
panel_19 = Panel("0")
convertepschvalues = Honeybee_ConvertEnergyPlusScheduleToValues(schName=csvschedule.csvSchedule)  # -> values, holidays; plug-in component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
legendpar_3 = Ladybug_LegendParameters(lowBound=panel_19, highBound="1", numSegments="2")  # -> legendPar; plug-in component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
point_6 = Point(Point(61, 11, 0))
_3dchart = Ladybug_3DChart(
    inputData=flatten(convertepschvalues.values),
    basePoint=point_6,
    xScale="0.01",
    yScale="0.04",
    zScale="0",
    legendPar=legendpar_3,
    condStatement="a>0")  # -> out, graphMesh, graphCurves, legend, legendBasePts, title, titleBasePts, dataPts, conditionalHOY; plug-in component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

# ----
# 1) Natürliche Lüftung / Querlüftung
toggle = BooleanToggle(False)
panel_20 = Panel("18")
panel_21 = Panel("24")
setepnatvent = Honeybee_SetEPAirFlow(
    HBZones=flatten(setepzoneschedules.HBZones),
    naturalVentilationType="1",
    fractionOfGlzAreaOperable="0.1",
    windDrivenCrossVent=toggle)  # -> readMe, simplify(HBZones); plug-in component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
panel_22 = Panel(setepnatvent.readMe)
überprüfung_4 = Panel(setepnatvent.HBZones)

# ----
# 2) Kaminlüftung / Bouyancy effect
panel_23 = Panel("10")
setepnatvent_2 = Honeybee_SetEPAirFlow(
    naturalVentilationType="2",
    fractionOfGlzAreaOperable="2",
    fractionOfGlzHeightOperable=panel_23,
    stackDischargeCoeff="0.17",
    windowAngle2North="0")  # -> readMe, simplify(HBZones); plug-in component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

# ----
# 3) Fan-Driven
panel_24 = Panel("3")
setepnatvent_3 = Honeybee_SetEPAirFlow(naturalVentilationType=panel_24, fractionOfGlzAreaOperable="2")  # -> readMe, simplify(HBZones); plug-in component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

# ----
# Wenn isConditioned ativiert ist, funktioniert
# die natural ventilation nicht, daher immer
# vorher prüfen, dass wenn eine natürliche
# Belüftung simuliert wird, dass bei den
# Zonen IsConditioned auf False gestellt
# wird.
# 4. LÜFTUNG
zoneattributelist = Honeybee_ZoneAttributeList({"Name": "name", "Zone Program": "zoneProgram", "Zone Floor Area": "zoneFloorArea", "Zone Volume": "zoneVolume", "Building Program": "bldgProgram", "Is Conditioned": "isConditioned", "HVAC System Type": "HVACSystem", "Occupancy Schedule": "occupancySchedule", "Occupancy Activity Schedule": "occupancyActivitySch", "Heating SetPoint Schedule": "heatingSetPtSchedule"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}, selected="Is Conditioned")
labelzones = Honeybee_LabelZones(HBZones=flatten(setepnatvent.HBZones), attribute=zoneattributelist)  # -> zoneTxtLabels, labelBasePts, brepTxtLabels, zoneWireFrames; plug-in component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
panel_25 = Panel(labelzones.zoneTxtLabels)

# ----
# Rechnung
tage_monat = Panel("""30
31
31
30
31
30
31""")
mass_addition = MassAddition(Input=tage_monat)  # -> Result, PartialResults
stunden_pro_tag = Panel("24")
multiplication = Multiplication(A=mass_addition.Result, B=stunden_pro_tag)
panel_26 = Panel(multiplication)

# ----
# Rechnung
tage_monat_2 = Panel("""31
28
31
30
31""")
mass_addition_2 = MassAddition(Input=tage_monat_2)  # -> Result, PartialResults
stunden_pro_tag_2 = Panel("24")
multiplication_2 = Multiplication(A=mass_addition_2.Result, B=stunden_pro_tag_2)
panel_27 = Panel(multiplication_2)

panel_28 = Panel("""0
0
0
0
0
0
0
0
0
1
1
1
1
1
1
1
1
1
1
0
0
0
0
0""")
panel_29 = Panel("""1
1
1
1
1
1
1
1
1
0
0
0
0
0
0
0
0
0
0
1
1
1
1
1""")
repeat_2 = RepeatData(Data=panel_29, Length=multiplication)
repeat_3 = RepeatData(Data=panel_28, Length=multiplication_2)
csvschedule_2 = Honeybee_CreateCSVSchedule(values=[repeat_3, repeat_2], scheduleName="Verschattung", writeFile=Toggle(True))  # -> readMe, csvSchedule; plug-in component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

# ----
# 5. VERSCHATTUNG UND KONTEXT
# Hier können ebenfalls mehrere Komponenten erstellt werden und
# unterschiedliche Zeiten/Schedules dafür definiert werden, um z.B.
# Verschattungselemente im Sommer zu simulieren.
# Verschattungselemente brauchen keine vollständigen Zonen bilden!
context_internalised = Brep(<brep referenced from the Rhino model>)
context_internalised_2 = Brep(<brep referenced from the Rhino model>)
hb_epcontextsrf = HoneybeeEPContextSurfaces(shdSurfaces=flatten(context_internalised))  # -> HBContext; inputs shdSurfaces: list of Brep, justBoundingBox: Boolean
# ---------- hb_epcontextsrf: Python ----------
"""
prepare shading/context geometries

    Args:
        northVectorOrRotation: A vector that shows North or a number that shows
                               the rotation of the North from the Y axis
        bldgMasses: List of closed Breps as thermal zones.
    Returns:
        report: ...
        thermalZones: Thermal zone's geometries for visualiza
"""

ghenv.Component.Name = 'Honeybee EP context Surfaces'
ghenv.Component.NickName = 'HB_EPContextSrf'
ghenv.Component.Message = 'VER 0.0.66\nJUL_07_2020'
ghenv.Component.IconDisplayMode = ghenv.Component.IconDisplayMode.application
ghenv.Component.Category = "HB-Legacy"
ghenv.Component.SubCategory = "10 | Energy | Energy"
#compatibleHBVersion = VER 0.0.57\nNOV_04_2016
#compatibleLBVersion = VER 0.0.59\nFEB_01_2015
ghenv.Component.AdditionalHelpFromDocStrings = "2"

import rhinoscriptsyntax as rs
import Rhino as rc
import scriptcontext as sc
import os
import System
import Grasshopper.Kernel as gh
import uuid

tolerance = sc.doc.ModelAbsoluteTolerance
import math


def main(shdSurfaces, EPTransSchedule, meshingSettings, justBoundingBox):
    
    # import the classes
    if sc.sticky.has_key('honeybee_release'):

        try:
            if not sc.sticky['honeybee_release'].isCompatible(ghenv.Component): return -1
            if sc.sticky['honeybee_release'].isInputMissing(ghenv.Component): return -1
        except:
            warning = "You need a newer version of Honeybee to use this compoent." + \
            " Use updateHoneybee component to update userObjects.\n" + \
            "If you have already updated userObjects drag Honeybee_Honeybee component " + \
            "into canvas and try again."
            w = gh.GH_RuntimeMessageLevel.Warning
            ghenv.Component.AddRuntimeMessage(w, warning)
            return -1
        
        # don't customize this part
        hb_EPSrf = sc.sticky["honeybee_EPSurface"]
        hb_EPSHDSurface = sc.sticky["honeybee_EPShdSurface"]
        hb_RADMaterialAUX = sc.sticky["honeybee_RADMaterialAUX"]
        hb_EPObjectsAux = sc.sticky["honeybee_EPObjectsAUX"]()
        HBScheduleList = sc.sticky["honeybee_ScheduleLib"].keys()

        ########################################################################
        #----------------------------------------------------------------------#
        shdBreps = []
        # create bounding box of shading geometries
        if justBoundingBox:
            for brep in shdSurfaces:
                if brep.Faces.Count>1 or not brep.Faces[0].IsPlanar(sc.doc.ModelAbsoluteTolerance):
                    shdBreps.append(brep.GetBoundingBox(True).ToBrep())
                else:
                    shdBreps.append(brep)
        else:
            shdBreps = shdSurfaces
        
        shadingClasses = []
        shadingMeshPreview = []
        
        if meshingSettings == None:
            mp = rc.Geometry.MeshingParameters.Minimal
            mp.SimplePlanes = True
        else:
            mp = meshingSettings
        
        def getRadMaterialName(radMaterial):
            nameStr = radMaterial.split(" ")[2]
            name =  nameStr.split("\n")[0]
            return name
        
        for brepCount, brep in enumerate(shdBreps):
            if brep != None:
                isPlanar = True
                # check planarity
                for face in brep.Faces:
                    if not face.IsPlanar(tolerance):
                        isPlanar = False
                        break
                
                shadingBreps = []
                if not isPlanar:
                    meshArray = rc.Geometry.Mesh.CreateFromBrep(brep, mp)
                    for mesh in meshArray:
                        for meshFace in range(mesh.Faces.Count):
                            vertices = list(mesh.Faces.GetFaceVertices(meshFace))[1:]
                            vertices = vertices + [sc.doc.ModelAbsoluteTolerance]
                            # create the brep from mesh
                            shdBrep = rc.Geometry.Brep.CreateFromCornerPoints(*vertices)
                            shadingBreps.append(shdBrep)
                else:
                    for face in brep.Faces:
                        shadingBreps.append(face.DuplicateFace(False))
                
                for faceCount, shdBrep in enumerate(shadingBreps):
                        thisShading = hb_EPSHDSurface(shdBrep, 1000*brepCount + faceCount, 'shdSrf_' + `brepCount` + '_' + `faceCount` + "_" + str(uuid.uuid4()))
                        
                        # add transmittance schedule if any
                        if EPTransSchedule!=None:
                            schedule= EPTransSchedule.upper()
                            if schedule!=None and not schedule.lower().endswith(".csv") and schedule not in HBScheduleList:
                                msg = "Cannot find " + schedule + " in Honeybee schedule library."
                                print msg
                                ghenv.Component.AddRuntimeMessage(gh.GH_RuntimeMessageLevel.Warning, msg)
                                return -1
                            elif schedule!=None and schedule.lower().endswith(".csv"):
                                # check if csv file is existed
                                if not os.path.isfile(schedule):
                                    msg = "Cannot find the shchedule file: " + schedule
                                    print msg
                                    ghenv.Component.AddRuntimeMessage(gh.GH_RuntimeMessageLevel.Warning, msg)
                                    return -1
                            
                            thisShading.TransmittanceSCH = schedule
                        
                        # add the Rad Material if any
                        if RADMaterial!=None:
                            # if it is just the name of the material make sure it is already defined
                            if len(RADMaterial.split(" ")) == 1:
                                # if the material is not in the library add it to the library
                                if not hb_RADMaterialAUX.isMatrialExistInLibrary(RADMaterial):
                                    warningMsg = "Can't find " + RADMaterial + " in RAD Material Library.\n" + \
                                                "Add the material to the library and try again."
                                    ghenv.Component.AddRuntimeMessage(gh.GH_RuntimeMessageLevel.Warning, warningMsg)
                                    return
                                
                                try:
                                    thisShading.setRADMaterial(RADMaterial)
                                except Exception, e:
                                    print e
                                    warningMsg = "You are using an old version of Honeybee_Honeybee! Update your files and try again."
                                    print warningMsg
                                    ghenv.Component.AddRuntimeMessage(gh.GH_RuntimeMessageLevel.Warning, warningMsg)
                                    return
                                
                                addedToLib = True
                            else:
                                
                                # try to add the material to the library
                                addedToLib, thisShading.RadMaterial = hb_RADMaterialAUX.analyseRadMaterials(RADMaterial, True)
                                
                            if addedToLib==False:
                                warningMsg = "Failed to add " + RADMaterial + " to the Library."
                                ghenv.Component.AddRuntimeMessage(gh.GH_RuntimeMessageLevel.Warning, warningMsg)
                                return
                        
                        # add shading to the list
                        shadingClasses.append(thisShading)
                
        # add to the hive
        hb_hive = sc.sticky["honeybee_Hive"]()
        HBContext  = hb_hive.addToHoneybeeHive(shadingClasses, ghenv.Component)
        return HBContext
        ################################################################################################
    else:
        print "You should first let Honeybee to fly..."
        w = gh.GH_RuntimeMessageLevel.Warning
        ghenv.Component.AddRuntimeMessage(w, "You should first let Honeybee to fly...")
        return -1
        

if _shdSurfaces and _shdSurfaces[0]!=None:
    # add cleaning function
    result= main(_shdSurfaces, EPTransSchedule_, meshingSettings_, justBoundingBox_)
    
    if result != -1: HBContext = result
# ---------- end hb_epcontextsrf ----------
hb_epcontextsrf_2 = HoneybeeEPContextSurfaces(shdSurfaces=flatten(context_internalised_2), EPTransSchedule=csvschedule_2.csvSchedule)  # -> HBContext; inputs shdSurfaces: list of Brep, justBoundingBox: Boolean; same code as hb_epcontextsrf

point_7 = Point(Point(61, -4, 0))

convertepschvalues_2 = Honeybee_ConvertEnergyPlusScheduleToValues(schName=csvschedule_2.csvSchedule)  # -> values, holidays; plug-in component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
_3dchart_2 = Ladybug_3DChart(
    inputData=flatten(convertepschvalues_2.values),
    basePoint=point_7,
    xScale="0.01",
    yScale="0.04",
    zScale="0",
    legendPar=legendpar_3,
    condStatement="a>0")  # -> out, graphMesh, graphCurves, legend, legendBasePts, title, titleBasePts, dataPts, conditionalHOY; plug-in component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

# ----
# Zonenreihenfolge
getsethbobjname = Honeybee_GetOrSetHBObjectName(HBObjects=setepnatvent.HBZones)  # -> HBObjects, names; plug-in component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
panel_30 = Panel(getsethbobjname.names)

series_2 = Series(Start=0, Step="0.1", Count=10)
gradient_2 = Gradient(LowerLimit=0, UpperLimit=1, Parameter=series_2, stops=[0: RGB(0, 128, 0), 0.5: RGB(255, 255, 0), 1: RGB(255, 0, 0)])
tiefster_wert = Panel("0")
höchster_wert = Panel("225")
anzahl = Panel("10")
legendpar_4 = Ladybug_LegendParameters(lowBound=tiefster_wert, highBound=höchster_wert, numSegments=anzahl, customColors=flatten(gradient_2))  # -> legendPar; plug-in component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

# ----
# Wetterdaten importieren
wetterdaten_ulr = Panel("https://www.energyplus.net/weather-download/europe_wmo_region_6/DEU//DEU_Bremen.102240_IWEC/all")
epw_stat = Ladybug_OpenEPWAndSTATWeatherFiles(weatherFileURL=wetterdaten_ulr)  # -> epwFile, statFile; plug-in component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
open_weather_file = Ladybug_OpenEPWWeatherFile(open=Toggle(True))  # -> epwFile; plug-in component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

# ----
# Switch
boolean_toggle_4 = BooleanToggle(True)
stream_filter = StreamFilter(Gate=boolean_toggle_4, Stream0=open_weather_file, Stream1=epw_stat.epwFile)

importepw = Ladybug_ImportEpw(epwFile=stream_filter)  # -> Output, latitude, location, dryBulbTemperature, dewPointTemperature, relativeHumidity, windSpeed, windDirection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; plug-in component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

# ----
# Wetterdaten Zeitraum
data_6 = Panel(importepw.location)
cull_index = CullIndex(List=importepw.modelYear, Indices=[0, 1, 2, 3, 4, 5, 6, 7], Wrap=True)
highest_lowest_numbers = HighestLowestNumbers(Numbers=cull_index)  # -> Highest, Lowest
information = Panel(importepw.Output)
panel_31 = Panel(highest_lowest_numbers.Highest)
panel_32 = Panel(highest_lowest_numbers.Lowest)

# ----
# Wetterdaten aus EPW
# _drybulbtemperature
# _relativehumidity
# _barometricPressure
data_7 = Data(importepw.dryBulbTemperature)
data_8 = Data(importepw.relativeHumidity)
data_9 = Data(importepw.barometricPressure)

# ----
# Wetterdaten aus EPW
# _location
data_10 = Data(importepw.dryBulbTemperature)
data_11 = Data(importepw.location)

# ----
# Wetterdaten aus EPW
# _drybulbtemperature
data_12 = Data(importepw.dryBulbTemperature)

# ----
# Adaptive Chart
panel_33 = Panel("0.1")
series_3 = Series(Start=0, Step=panel_33, Count=10)
gradient_3 = Gradient(
    LowerLimit=0,
    UpperLimit=1,
    Parameter=series_3,
    stops=[0: RGB(75, 107, 169), 0.251: RGB(173, 203, 249), 0.5: RGB(254, 244, 84), 0.755: RGB(234, 126, 0), 1: RGB(234, 38, 0)])
tiefster_wert_2 = Panel("0")
höchster_wert_2 = Panel("225")
anzahl_2 = Panel("10")
legendpar_5 = Ladybug_LegendParameters(lowBound=tiefster_wert_2, highBound=höchster_wert_2, numSegments=anzahl_2, customColors=flatten(gradient_3))  # -> legendPar; plug-in component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
point_8 = Point(Point(60, 81, 0))
adaptivechart = Ladybug_AdaptiveComfortChart(
    dryBulbTemperature=data_12,
    outdoorTemperature=data_12,
    basePoint=point_8,
    scale="0.4",
    legendPar=legendpar_5,
    runIt=Toggle(True))  # -> out, comfPercentOfTime, percentHotCold, comfortableOrNot, conditionOfPerson, degreesFromTarget, prevailingTemp, targetTemperature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; plug-in component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
panel_34 = Panel(adaptivechart.comfPercentOfTime)
panel_35 = Panel(adaptivechart.percentHotCold)
pie_chart = PieChart(adaptivechart.conditionOfPerson)

# ----
# Wetterdaten aus EPW
# _drybulbtemperature
data_13 = Data(importepw.dryBulbTemperature)
data_14 = Data(importepw.windSpeed)

# ----
# Wetterdaten aus EPW
# _drybulbtemperature
# oder z.B.
# _relativehumidity
# _wind
data_15 = Data(importepw.dryBulbTemperature)
data_16 = Data(importepw.relativeHumidity)
data_17 = Data(importepw.windSpeed)

# ----
# Wetterdaten aus EPW
# _windspeed
# _winddirection
data_18 = Data(importepw.windDirection)
data_19 = Data(importepw.windSpeed)

# ----
# 3D Chart, Temperaturen & Luftfeuchtigkeit
panel_36 = Panel("0.1")
series_4 = Series(Start=0, Step=panel_36, Count=10)
gradient_4 = Gradient(
    LowerLimit=0,
    UpperLimit=1,
    Parameter=series_4,
    stops=[0: RGB(75, 107, 169), 0.251: RGB(173, 203, 249), 0.5: RGB(254, 244, 84), 0.755: RGB(234, 126, 0), 1: RGB(234, 38, 0)])
tiefster_wert_3 = Panel("0")
höchster_wert_3 = Panel("30")
anzahl_3 = Panel("11")
legendpar_6 = Ladybug_LegendParameters(lowBound=tiefster_wert_3, highBound=höchster_wert_3, numSegments=anzahl_3, customColors=flatten(gradient_4))  # -> legendPar; plug-in component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
beispiel_conditional_statement = Panel("a>15 and c>4")
_3dchart_3 = Ladybug_3DChart(inputData=flatten(data_15), basePoint=point_4, xScale="0.01", yScale="0.04", zScale="0", legendPar=legendpar_6)  # -> readMe, graphMesh, graphCurves, legend, legendBasePts, title, titleBasePts, dataPts, conditionalHOY; plug-in component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
_3dchart_4 = Ladybug_3DChart(
    inputData=flatten([data_15, data_16, data_17]),
    basePoint=point_3,
    xScale="0.01",
    yScale="0.04",
    zScale="0",
    condStatement=beispiel_conditional_statement)  # -> readMe, graphMesh, graphCurves, legend, legendBasePts, title, titleBasePts, dataPts, conditionalHOY; plug-in component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
custom_preview = CustomPreview(
    Geometry=[_3dchart_3.graphMesh, _3dchart_3.graphCurves, _3dchart_3.legend],
    Shader=ColourSwatch(SwatchColor=RGB(0, 0, 0)))

# ----
# Adaptive Comfort Calculator
boolean_toggle_5 = BooleanToggle(True)
adaptivecomfortcalculator = Ladybug_AdaptiveComfortCalculator(dryBulbTemperature=data_13, outdoorTemperature=data_13, windSpeed=data_14, runIt=boolean_toggle_5)  # -> out, port, comfortableOrNot, conditionOfPerson, degreesFromTarget, port_2, targetTemperature, upperTemperatureBound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; plug-in component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
personen_komfortabel = Panel(adaptivecomfortcalculator.percentOfTimeComfortable)
zu_warm_kalt_in = Panel(adaptivecomfortcalculator.percentHotCold)
pie_chart_2 = PieChart(adaptivecomfortcalculator.comfortableOrNot)
pie_chart_3 = PieChart(adaptivecomfortcalculator.conditionOfPerson)

# ----
# Preview: Nein
# Enable: Nein
# Preview: Nein
# Enable: Ja
# Preview: Ja
# Enable: Ja
adaptivecomfortcalculator_2 = Ladybug_AdaptiveComfortCalculator(dryBulbTemperature=data_13, outdoorTemperature=data_13, runIt=boolean_toggle_5)  # -> out, port, comfortableOrNot, conditionOfPerson, degreesFromTarget, port_2, targetTemperature, upperTemperatureBound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; plug-in component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
adaptivecomfortcalculator_3 = Ladybug_AdaptiveComfortCalculator(dryBulbTemperature=data_13, outdoorTemperature=data_13, runIt=boolean_toggle_5)  # -> out, port, comfortableOrNot, conditionOfPerson, degreesFromTarget, port_2, targetTemperature, upperTemperatureBound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; plug-in component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
adaptivecomfortcalculator_4 = Ladybug_AdaptiveComfortCalculator(dryBulbTemperature=data_13, outdoorTemperature=data_13, runIt=boolean_toggle_5)  # -> out, port, comfortableOrNot, conditionOfPerson, degreesFromTarget, port_2, targetTemperature, upperTemperatureBound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; disabled; plug-in component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

# ----
# Windrose
panel_37 = Panel("0.1")
series_5 = Series(Start=0, Step=panel_37, Count=10)
gradient_5 = Gradient(
    LowerLimit=0,
    UpperLimit=1,
    Parameter=series_5,
    stops=[0: RGB(255, 255, 255), 0.215: RGB(255, 218, 153), 0.51: RGB(255, 166, 10), 0.916: RGB(255, 83, 10)])
tiefster_wert_4 = Panel("0")
höchster_wert_4 = Panel("20")
anzahl_4 = Panel("11")
legendpar_7 = Ladybug_LegendParameters(lowBound=tiefster_wert_4, highBound=höchster_wert_4, numSegments=anzahl_4, customColors=flatten(gradient_5))  # -> legendPar; plug-in component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
skalierung = Panel("0.15")
windrose = Ladybug_WindRose(
    north=0,
    hourlyWindDirection=data_18,
    hourlyWindSpeed=data_19,
    centerPoint=point_5,
    scale=skalierung,
    legendPar=legendpar_7,
    runIt=Toggle(True))  # -> readMe, calmRoseMesh, windRoseMesh, windRoseCrvs, windRoseCenPts, legend, legendBasePts, title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; plug-in component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
frequencies = Panel(windrose.frequencies)
average = Average(Input=windrose.averageVelocities)
custom_preview_2 = CustomPreview(
    Geometry=[windrose.windRoseCrvs, windrose.windRoseMesh, windrose.calmRoseMesh],
    Shader=ColourSwatch(SwatchColor=RGB(0, 0, 0)))
average_velocities_m_s = Panel(windrose.averageVelocities)
average_vel_all_m_s = Panel(average)

# ----
# Psychrometic Chart (Mollier-h-x Diagramm)
ladybug_passive_strategy_list = Ladybug_PassiveStrategyList({"Evaporative Cooling", "Thermal Mass + Night Vent", "Occupant Use of Fans", "Capture Internal Heat Gain": "Internal Heat Gain", "Passive Solar Heating", "Dessicant Dehumidification", "Dehumidification Only", "Humidification Only"}, selected="Capture Internal Heat Gain")
pmvcomfortpar = Ladybug_PMVComfortParameters(humidRatioUpBound="0.014", humidRatioLowBound="0.004")  # -> comfortPar; plug-in component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
psychchart = Ladybug_PsychrometricChart(
    dryBulbTemperature=data_7,
    relativeHumidity=data_8,
    barometricPressure=data_9,
    windSpeed=average_vel_all_m_s,
    metabolicRate=activitieslist,
    clothingLevel=clothin_level,
    comfortPar=pmvcomfortpar,
    passiveStrategy=ladybug_passive_strategy_list,
    mollierHX=Toggle(False),
    basePoint=point_2,
    scale="0.4",
    runIt=Toggle(True))  # -> readMe, port, totalComfortPercent, totalComfortOrNot, strategyNames, strategyPercentOfTime, strategyOrNot, port_2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; plug-in component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
panel_38 = Panel(psychchart.strategyNames)
panel_39 = Panel(psychchart.strategyPercentOfTime)
panel_40 = Panel(psychchart.totalComfortPercent)
custom_preview_3 = CustomPreview(Geometry=[psychchart.chartCurvesAndTxt, psychchart.psychChartMesh], Shader=ColourSwatch(SwatchColor=RGB(0, 0, 0)))
custom_preview_4 = CustomPreview(Geometry=psychchart.comfortPolygons, Shader=ColourSwatch(SwatchColor=RGB(255, 0, 0)))
custom_preview_5 = CustomPreview(Geometry=psychchart.strategyPolygons, Shader=ColourSwatch(SwatchColor=RGB(255, 194, 82)))

# ----
# Sonnenverlauf / Sun Path
panel_41 = Panel("0")
series_6 = Series(Start=panel_41, Step=1, Count="24")
series_7 = Series(Start="0", Step=1, Count="12")
skalierung_2 = Panel("0.15")
point_9 = Point(Point(0, 0, 0))
vector_2 = Vector(Vector(0, 61, 0))
sunpath = Ladybug_SunPath(
    north=vector_2,
    location=data_11,
    hour=series_6,
    day=21,
    month=series_7,
    timeStep=1,
    centerPt=point_9,
    sunPathScale=skalierung_2,
    annualHourlyData=flatten(data_10),
    dailyOrAnnualSunPath=True)  # -> out, sunVectors, sunAltitudes, sunAzimuths, port, sunSpheresMesh, sunPathCrvs, compassCrvs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; plug-in component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
custom_preview_6 = CustomPreview(
    Geometry=[sunpath.compassCrvs, sunpath.sunSpheresMesh, sunpath.sunPathCrvs],
    Shader=ColourSwatch(SwatchColor=RGB(0, 0, 0)))

panel_42 = Panel(series_6)

# ----
# Wetterdaten aus EPW
# _drybulbtemperature
# _windspeed
# _humidity
data_20 = Data(importepw.relativeHumidity)
data_21 = Data(importepw.dryBulbTemperature)
data_22 = Data(importepw.windSpeed)

outdoorcomfortcalculator = Ladybug_OutdoorComfortCalculator(dryBulbTemperature=data_21, windSpeed_tenMeters=data_22, relativeHumidity=data_20, runIt=Toggle(True))  # -> out, port, universalThermalClimateIndex, comfortableOrNot, thermalStress, conditionOfPerson, port_2, percentOfTimeComfortable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; plug-in component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
pie_chart_4 = PieChart(outdoorcomfortcalculator.conditionOfPerson)
panel_43 = Panel(outdoorcomfortcalculator.percentOfTimeComfortable)

# ----
# Wetterdaten EPW
data_23 = Data(stream_filter)

gencumulativeskymtx = Ladybug_GenCumulativeSkyMtx(epwFile=data_23, skyDensity=0, useOldRes=Toggle(False), runIt=Toggle(True))  # -> readMe, cumulativeSkyMtx; plug-in component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
selectskymtx = Ladybug_selectSkyMtx(cumulativeSkyMtx=gencumulativeskymtx.cumulativeSkyMtx, removeDiffuse=False, removeDirect=False)  # -> readMe, selectedSkyMtx; plug-in component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

# ----
# Radiation Analysis
toggle_2 = BooleanToggle(True)
context_internalised_3 = Brep(<brep referenced from the Rhino model>)
context_internalised_4 = Brep([<brep referenced from the Rhino model> x10])
radiationanalysis = Ladybug_RadiationAnalysis(
    geometry=flatten(context_internalised_4),
    context=flatten(context_internalised_3),
    gridSize="0.25",
    disFromBase="1",
    selectedSkyMtx=selectskymtx.selectedSkyMtx,
    legendPar=flatten(legendpar_2),
    parallel=toggle_2,
    runIt=toggle_2)  # -> readMe, contextMesh, analysisMesh, testPts, testVec, port, radiationResult, radiationMesh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; plug-in component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

# ----
# 6. SIMULATION
boolean_toggle_6 = BooleanToggle(True)
epoutput = Honeybee_GenerateEPOutput(
    zoneEnergyUse=boolean_toggle_6,
    zoneGainsAndLosses=boolean_toggle_6,
    zoneComfortMetrics=boolean_toggle_6,
    surfaceTempAnalysis="False")  # -> out, flatten(simulationOutputs); plug-in component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
name_für_verzeichnis_unter_c_ladybug = Panel("Honeybee_testsimulation")
boolean_toggle_7 = BooleanToggle(True)
epw_weather_file = Data(stream_filter)
runenergysimulation = Honeybee_RunEnergySimulation(
    epwFile=epw_weather_file,
    HBZones=flatten(setepnatvent.HBZones),
    HBContext=flatten([hb_epcontextsrf, hb_epcontextsrf_2]),
    simulationOutputs=flatten(epoutput.simulationOutputs),
    writeIdf=boolean_toggle_7,
    runEnergyPlus=boolean_toggle_7,
    idfFileName=name_für_verzeichnis_unter_c_ladybug)  # -> out, idfFileAddress, resultFileAddress, eioFileAddress, rddFileAddress, htmlReport, studyFolder; plug-in component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
readepresult = Honeybee_ReadEPResult(resultFileAddress=runenergysimulation.resultFileAddress)  # -> port, port_2, port_3, port_4, electricLight, electricEquip, fanElectric, port_5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; plug-in component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

panel_44 = Panel(runenergysimulation.resultFileAddress)

# ----
# 3D Chart, Temperaturen & Luftfeuchtigkeit
panel_45 = Panel("0.1")
series_8 = Series(Start=0, Step=panel_45, Count=10)
gradient_6 = Gradient(
    LowerLimit=0,
    UpperLimit=1,
    Parameter=series_8,
    stops=[0: RGB(75, 107, 169), 0.251: RGB(173, 203, 249), 0.5: RGB(254, 244, 84), 0.755: RGB(234, 126, 0), 1: RGB(234, 38, 0)])
tiefster_wert_5 = Panel("0")
höchster_wert_5 = Panel("30")
anzahl_5 = Panel("11")
legendpar_8 = Ladybug_LegendParameters(lowBound=tiefster_wert_5, highBound=höchster_wert_5, numSegments=anzahl_5, customColors=flatten(gradient_6))  # -> legendPar; plug-in component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
point_10 = Point(Point(108, -2, 0))
_3dchart_5 = Ladybug_3DChart(
    inputData=flatten(readepresult.airTemperature),
    basePoint=point_10,
    xScale="0.01",
    yScale="0.04",
    zScale="0",
    legendPar=legendpar_8)  # -> readMe, graphMesh, graphCurves, legend, legendBasePts, title, titleBasePts, dataPts, conditionalHOY; plug-in component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
custom_preview_7 = CustomPreview(
    Geometry=[_3dchart_5.graphMesh, _3dchart_5.graphCurves, _3dchart_5.legend],
    Shader=ColourSwatch(SwatchColor=RGB(0, 0, 0)))

# ----
# Predicted Mean Vote - PMV Calculator
activitieslist_2 = Ladybug_ActivitiesMetList({"Sleeping": 0.7, "Reclining": 0.8, "Sitting": 1.0, "Typing": 1.1, "Standing": 1.2, "Driving": 1.5, "Cooking": 1.8, "House Cleaning": 2.7, "Strolling": 1.7, "Walking 2mph": 2.0, "Walking 3mph": 2.6, "Walking 4mph": 3.8, "Running 9mph": 9.5, "Lifting 10lbs": 2.1, "Lifting 100lbs": 4.0, "Shoveling": 4.4, "Dancing": 3.4, "Basketball": 6.3}, selected="Sitting")
clothin_level_2 = Panel("0.3")
pmvcomfortcalculator = Ladybug_PMVComfortCalculator(
    dryBulbTemperature=readepresult.operativeTemperature,
    meanRadiantTemperature=readepresult.meanRadTemperature,
    relativeHumidity=readepresult.relativeHumidity,
    metabolicRate=activitieslist_2,
    clothingLevel=clothin_level_2,
    calcBalanceTemperature=Toggle(True),
    runIt=Toggle(True))  # -> readMe, port, predictedMeanVote, percentPeopleDissatisfied, standardEffectiveTemperature, port_2, comfortableOrNot, percentOfTimeComfortable, port_3, balanceTemperature; plug-in component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
series_9 = Series(Start=0, Step="0.1", Count=10)
gradient_7 = Gradient(LowerLimit=0, UpperLimit=1, Parameter=series_9, stops=[0: RGBA(255, 255, 255, 0), 1: RGB(0, 219, 58)])
legendpar_9 = Ladybug_LegendParameters(lowBound="0", highBound="1", numSegments="2", customColors=flatten(gradient_7))  # -> legendPar; plug-in component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
point_11 = Point(Point(254, -2, 0))
panel_46 = Panel(pmvcomfortcalculator.comfortableOrNot)
_3dchart_6 = Ladybug_3DChart(
    inputData=flatten(pmvcomfortcalculator.comfortableOrNot),
    basePoint=point_11,
    xScale="0.01",
    yScale="0.04",
    zScale="0",
    legendPar=legendpar_9)  # -> out, graphMesh, graphCurves, legend, legendBasePts, title, titleBasePts, dataPts, conditionalHOY; plug-in component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

# ----
# Wetterdaten aus EPW
# _drybulbtemperature
data_24 = Data(importepw.dryBulbTemperature)

# ----
# Solare Gewinne
panel_47 = Panel("0.1")
series_10 = Series(Start=0, Step=panel_47, Count=10)
gradient_8 = Gradient(
    LowerLimit=0,
    UpperLimit=1,
    Parameter=series_10,
    stops=[0: RGB(75, 107, 169), 0.251: RGB(173, 203, 249), 0.5: RGB(254, 244, 84), 0.755: RGB(234, 126, 0), 1: RGB(234, 38, 0)])
legendpar_10 = Ladybug_LegendParameters(customColors=flatten(gradient_8))  # -> legendPar; plug-in component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
point_12 = Point(Point(156, -2, 0))
_3dchart_7 = Ladybug_3DChart(
    inputData=flatten(readepresult.totalSolarGain),
    basePoint=point_12,
    xScale="0.01",
    yScale="0.04",
    zScale="0",
    legendPar=legendpar_10)  # -> out, graphMesh, graphCurves, legend, legendBasePts, title, titleBasePts, dataPts, conditionalHOY; plug-in component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

# ----
# Adaptive Comfort Calculator
boolean_toggle_8 = BooleanToggle(True)
adaptivecomfortcalculator_5 = Ladybug_AdaptiveComfortCalculator(
    dryBulbTemperature=readepresult.airTemperature,
    meanRadiantTemperature=readepresult.meanRadTemperature,
    outdoorTemperature=data_24,
    runIt=boolean_toggle_8)  # -> out, port, comfortableOrNot, conditionOfPerson, degreesFromTarget, port_2, targetTemperature, upperTemperatureBound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; plug-in component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
zu_warm_kalt_in_2 = Panel(adaptivecomfortcalculator_5.percentHotCold)
personen_komfortabel_2 = Panel(adaptivecomfortcalculator_5.percentOfTimeComfortable)
data_25 = Data(flatten(adaptivecomfortcalculator_5.percentOfTimeComfortable))
average_2 = Average(Input=data_25)
panel_48 = Panel(average_2)

panel_49 = Panel(pmvcomfortcalculator.percentOfTimeComfortable)

# ----
# Adaptive Chart für die einzelnen Zonen
explode_tree = ExplodeTree(Data=readepresult.airTemperature)  # -> Branch0, Branch1
explode_tree_2 = ExplodeTree(Data=readepresult.meanRadTemperature)  # -> Branch0, Branch1
point_13 = Point(Point(71, -46, 0))
point_14 = Point(Point(71, -70, 0))

panel_50 = Panel(explode_tree.Branch0)

# ----
# Adaptive Chart (Gesamtüberblick)
# Wetterdaten aus EPW
# _drybulbtemperature
data_26 = Data(importepw.dryBulbTemperature)
point_15 = Point(Point(71, -24, 0))
adaptivechart_2 = Ladybug_AdaptiveComfortChart(
    dryBulbTemperature=readepresult.airTemperature,
    meanRadiantTemperature=readepresult.meanRadTemperature,
    outdoorTemperature=data_26,
    basePoint=point_15,
    scale="0.4",
    legendPar=legendpar_4,
    runIt=Toggle(True))  # -> out, comfPercentOfTime, percentHotCold, comfortableOrNot, conditionOfPerson, degreesFromTarget, prevailingTemp, targetTemperature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; plug-in component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
data_27 = Data(flatten(adaptivechart_2.comfPercentOfTime))
panel_51 = Panel(adaptivechart_2.comfPercentOfTime)
average_3 = Average(Input=data_27)
panel_52 = Panel(average_3)

adaptivechart_3 = Ladybug_AdaptiveComfortChart(
    dryBulbTemperature=explode_tree.Branch0,
    meanRadiantTemperature=explode_tree_2.Branch0,
    outdoorTemperature=data_26,
    basePoint=point_13,
    scale="0.4",
    legendPar=legendpar_4,
    runIt=Toggle(True))  # -> out, comfPercentOfTime, percentHotCold, comfortableOrNot, conditionOfPerson, degreesFromTarget, prevailingTemp, targetTemperature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; plug-in component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
adaptivechart_4 = Ladybug_AdaptiveComfortChart(
    dryBulbTemperature=explode_tree.Branch1,
    meanRadiantTemperature=explode_tree_2.Branch1,
    outdoorTemperature=data_26,
    basePoint=point_14,
    scale="0.4",
    legendPar=legendpar_4,
    runIt=Toggle(True))  # -> out, comfPercentOfTime, percentHotCold, comfortableOrNot, conditionOfPerson, degreesFromTarget, prevailingTemp, targetTemperature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; plug-in component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

partition_list = PartitionList(List=adaptivechart_2.percentHotCold, Size="2")

panel_53 = Panel(partition_list)
