# Grasshopper definition Testgh.gh (Grasshopper 0.9.76)
# plug-ins: Python Interpreter

# ----
# WETTERANALYSE
# HINWEIS: RECHTSKLICK auf "NORDEN" und "set one Vector" und die Richtung des Nordens in der Rhino umgebung angeben - eingestellt ist zurzeit die Richtung der x Achse
norden = Vector(Vector(0, 22, 0))

# ----
# WETTERDATEN
# HINWEIS: TEMPERATURDATEN von:
# https://www.ladybug.tools/epwmap/
temperaturdaten = Panel("http://climate.onebuilding.org/WMO_Region_6_Europe/ISL_Iceland/NV_Northland_West/ISL_NV_Hveravellir.041560_TMYx.zip")
epw_stat = Ladybug_OpenEPWAndSTATWeatherFiles(weatherFileURL=temperaturdaten)  # -> epwFile, statFile; plug-in component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
importepw = Ladybug_ImportEpw(epwFile=epw_stat.epwFile)  # -> readMe, latitude, location, dryBulbTemperature, dewPointTemperature, relativeHumidity, windSpeed, windDirection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; plug-in component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

ladybug = Ladybug_Ladybug()  # -> out; plug-in component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
honeybee = Honeybee_Honeybee()  # -> out; plug-in component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

# ----
# Dark Mode
boolean_toggle = BooleanToggle(True)

panel = Panel(honeybee)

# ----
# Klimazone
importstat = Ladybug_ImportStat(statFile=epw_stat.statFile)  # -> out, ashraeClimateZone, koppenClimateZone, heatingDesignTemps, coolingDesignTemps, heatingDesignDay, coolingDesignDay, monthlyTauBeam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; plug-in component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
panel_2 = Panel(importstat.ashraeClimateZone)

# ----
# Example of getting max and min. Temp. of Lists
panel_3 = Panel(importepw.dryBulbTemperature)
split_list = SplitList(List=panel_3, Index="7")  # -> ListA, ListB
sort_list = SortList(Keys=split_list.ListB)  # -> Keys, ValuesA
cleanlist = Panel(sort_list.Keys)
panel_4 = Panel("""0
-1""")
list_item = ListItem(List=cleanlist, Index=panel_4, Wrap=True)
min_max_value_temperature = Panel(list_item)

# ---- group: mean monthly air temperature per hour
selectandaveragedata = Ladybug_AverageData(annualHourlyData=importepw.dryBulbTemperature)  # -> readMe, selHourlyData, averagedDaily, averagedMonthly, avrMonthlyPerHour, avrAnalysisPeriod; plug-in component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

# ---- group: monthly mean minimum and maximum air temperatures per hour
branchdatadailymonthlyhourly = Ladybug_BranchData(data=importepw.dryBulbTemperature)  # -> dataEachDayOfYear, dataEachMonth, dataEachHourOfDay; plug-in component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
path_mapper = PathMapper(branchdatadailymonthlyhourly.dataEachDayOfYear, source="{A;B}(i)", target="{A;i}(B)")
strnum = Ladybug_SeparateData(inputList=flatten(selectandaveragedata.avrMonthlyPerHour))  # -> numbers, strings; plug-in component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
sort = SortList(Keys=path_mapper)  # -> Keys, ValuesA
item = ListItem(List=sort.Keys, Index=0, Wrap=True)
rev = ReverseList(List=sort.Keys)
item_2 = ListItem(List=rev, Index=0, Wrap=True)
mean_min_temp = Data(flatten([strnum.strings, item]))
mean_max_tem = Data(flatten([strnum.strings, item_2]))

# ----
activitieslist = Ladybug_ActivitiesMetList({"Sleeping": 0.7, "Reclining": 0.8, "Sitting": 1.0, "Typing": 1.1, "Standing": 1.2, "Driving": 1.5, "Cooking": 1.8, "House Cleaning": 2.7, "Strolling": 1.7, "Walking 2mph": 2.0, "Walking 3mph": 2.6, "Walking 4mph": 3.8, "Running 9mph": 9.5, "Lifting 10lbs": 2.1, "Lifting 100lbs": 4.0, "Shoveling": 4.4, "Dancing": 3.4, "Basketball": 6.3}, selected="Sitting")
clothin_level = Panel("0.3")

# ----
# FILTERN
beispiel_conditional_statement = Panel("a>60")

# ----
# FILTERN
beispiel_conditional_statement_2 = Panel("a>25")

series = Series(Start="0", Step=1, Count="12")
series_2 = Series(Start="0", Step=1, Count="24")
legendpar = Ladybug_LegendParameters(lowBound="-5", highBound="25", numSegments="7")  # -> legendPar; plug-in component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

# ----
# Sun Path
koordinaten = Panel("0,0,0")
sunpath = Ladybug_SunPath(
    north=norden,
    location=importepw.location,
    hour=series_2,
    day=21,
    month=series,
    timeStep=1,
    centerPt=koordinaten,
    sunPathScale="0.15",
    annualHourlyData=flatten(importepw.dryBulbTemperature),
    legendPar=legendpar,
    dailyOrAnnualSunPath=True)  # -> out, sunVectors, sunAltitudes, sunAzimuths, port, sunSpheresMesh, sunPathCrvs, compassCrvs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; disabled; plug-in component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
# Koordinaten
custom_preview = CustomPreview(
    Geometry=[sunpath.compassCrvs, sunpath.sunSpheresMesh, sunpath.sunPathCrvs],
    Shader=ColourSwatch(SwatchColor=RGB(0, 0, 0)))

# ----
# AverageTemp. Data
panel_5 = Panel("11")
legendpar_2 = Ladybug_LegendParameters(
    lowBound="-15",
    highBound="35",
    numSegments=panel_5,
    customColors=flatten([ColourSwatch(SwatchColor=RGB(3, 0, 0)), ColourSwatch(SwatchColor=RGB(0, 0, 0)), ColourSwatch(SwatchColor=RGB(255, 84, 10))]),
    fontSize=Slider(1.5, range=1..30))  # -> legendPar; plug-in component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
point = Point(Point(-147, -160, 0))
barchart = Ladybug_MonthlyBarChart(
    inputData=flatten([selectandaveragedata.avrMonthlyPerHour, mean_min_temp, mean_max_tem]),
    comfortModel="2",
    basePoint=point,
    yScale=Slider(1, range=1..2),
    legendPar=legendpar_2)  # -> readMe, dataMesh, dataCurves, dataCrvColors, graphAxes, graphLabels, title, titleBasePt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; disabled; plug-in component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

# ---- group: preview stuff
mesh = Mesh(barchart.comfortBand)
mesh_2 = Mesh(barchart.title)
geo = Geometry(barchart.graphLabels)
mesh_3 = Mesh(barchart.legend)
crv = Curve(barchart.dataCurves)
geo_2 = Geometry(barchart.graphAxes)
preview = CustomPreview(Geometry=geo_2, Shader=ColourSwatch(SwatchColor=RGB(82, 82, 82)))
preview_2 = CustomPreview(Geometry=mesh, Shader=ColourSwatch(SwatchColor=RGB(255, 84, 10)))

# ----
# Wind
cluster = Cluster()

# ----
# HINWEIS: LOW BOUND - Definiert den untersten Wert
# High BOUND - Definiert den höchsten Wert
# SEGMENTS - Definiert die Anzahl der Unterteilungen (Hier immer die gewünschte Anzahl + 1)
gradient = Gradient(
    LowerLimit=0,
    UpperLimit=1,
    Parameter=cluster,
    stops=[0: RGB(255, 255, 255), 0.215: RGB(255, 218, 153), 0.51: RGB(255, 166, 10), 0.916: RGB(255, 83, 10)])
low_bound = Panel("0")
high_bound = Panel("20")
segments = Panel("11")

cluster_2 = Cluster_4(lowbound=low_bound, highbound=high_bound, numsegments=segments, customcolors=gradient)  # -> legendpar_2, koordinaten_2, scale_2, boolean_toggle
windrose = Ladybug_WindRose(
    north=norden,
    hourlyWindDirection=importepw.windDirection,
    hourlyWindSpeed=importepw.windSpeed,
    centerPoint=cluster_2.koordinaten_2,
    scale=cluster_2.scale_2,
    legendPar=cluster_2.legendpar_2,
    runIt=cluster_2.boolean_toggle)  # -> readMe, calmRoseMesh, windRoseMesh, windRoseCrvs, windRoseCenPts, legend, legendBasePts, title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; disabled; plug-in component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
custom_preview_2 = CustomPreview(
    Geometry=[windrose.windRoseCrvs, windrose.windRoseMesh, windrose.calmRoseMesh],
    Shader=ColourSwatch(SwatchColor=RGB(0, 0, 0)))
frequencies = Panel(windrose.frequencies)
average = Average(Input=windrose.averageVelocities)
average_velocities_m_s = Panel(windrose.averageVelocities)
average_vel_all_m_s = Panel(average)

# ----
# Psych-Chart
# Komfortbereich
cluster_3 = Cluster_5()  # -> koordinates_2, comfortpar, scale_2, boolean_toggle
psychchart = Ladybug_PsychrometricChart(
    dryBulbTemperature=importepw.dryBulbTemperature,
    relativeHumidity=importepw.relativeHumidity,
    barometricPressure=importepw.barometricPressure,
    windSpeed=average_vel_all_m_s,
    metabolicRate=activitieslist,
    clothingLevel=clothin_level,
    comfortPar=cluster_3.comfortpar,
    mollierHX=Toggle(False),
    basePoint=cluster_3.koordinates_2,
    scale=cluster_3.scale_2,
    runIt=cluster_3.boolean_toggle)  # -> readMe, port, totalComfortPercent, totalComfortOrNot, strategyNames, strategyPercentOfTime, strategyOrNot, port_2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; disabled; plug-in component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
panel_6 = Panel(psychchart.totalComfortPercent)
custom_preview_3 = CustomPreview(Geometry=[psychchart.chartCurvesAndTxt, psychchart.psychChartMesh], Shader=ColourSwatch(SwatchColor=RGB(0, 0, 0)))
custom_preview_4 = CustomPreview(Geometry=psychchart.comfortPolygons, Shader=ColourSwatch(SwatchColor=RGB(255, 0, 0)))
custom_preview_5 = CustomPreview(Geometry=psychchart.strategyPolygons, Shader=ColourSwatch(SwatchColor=RGB(255, 194, 82)))

# ----
# Adaptive Comfort
boolean_toggle_2 = BooleanToggle(True)
cluster_4 = Cluster_6()  # -> koordinaten_2, panel
adaptivechart = Ladybug_AdaptiveComfortChart(
    dryBulbTemperature=importepw.dryBulbTemperature,
    outdoorTemperature=importepw.dryBulbTemperature,
    windSpeed=average_vel_all_m_s,
    basePoint=cluster_4.koordinaten_2,
    scale=cluster_4.panel,
    runIt=boolean_toggle_2)  # -> out, comfPercentOfTime, percentHotCold, comfortableOrNot, conditionOfPerson, degreesFromTarget, prevailingTemp, targetTemperature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; disabled; plug-in component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
custom_preview_6 = CustomPreview(
    Geometry=[adaptivechart.chartCurvesAndTxt, adaptivechart.adaptiveChartMesh],
    Shader=ColourSwatch(SwatchColor=RGB(0, 0, 0)))
custom_preview_7 = CustomPreview(Geometry=adaptivechart.comfortPolygons, Shader=ColourSwatch(SwatchColor=RGB(255, 0, 0)))

pie_chart = PieChart(adaptivechart.conditionOfPerson)
pie_chart_2 = Panel("""-1 	- too cold
0 	- comfortable
+1 	- to warm""")

_0_to_hot_1_to_cold = Panel(adaptivechart.percentHotCold)
panel_7 = Panel(adaptivechart.comfPercentOfTime)

# ----
# Temperaturen
cluster_5 = Cluster()

# ----
# Skalaeinstellungen
# HINWEIS: LOW BOUND - Definiert den untersten Wert
# High BOUND - Definiert den höchsten Wert
# SEGMENTS - Definiert die Anzahl der Unterteilungen (Hier immer die gewünschte Anzahl + 1)
gradient_2 = Gradient(
    LowerLimit=0,
    UpperLimit=1,
    Parameter=cluster_5,
    stops=[0.0731: RGB(48, 214, 255), 0.311: RGB(255, 191, 122), 0.636: RGB(255, 94, 0), 0.921: RGB(255, 0, 0)])
low_bound_2 = Panel("-21")
high_bound_2 = Panel("19")
segments_2 = Panel("11")

cluster_6 = Cluster_3(lowbound=low_bound_2, highbound=high_bound_2, numsegments=segments_2, customcolors=gradient_2)  # -> koordinaten_2, panel_3, legendpar_2, panel, panel_2

_3dchart = Ladybug_3DChart(
    inputData=flatten(importepw.dryBulbTemperature),
    basePoint=cluster_6.koordinaten_2,
    xScale=cluster_6.panel,
    yScale=cluster_6.panel_2,
    zScale=cluster_6.panel_3,
    legendPar=cluster_6.legendpar_2)  # -> readMe, graphMesh, graphCurves, legend, legendBasePts, title, titleBasePts, dataPts, conditionalHOY; plug-in component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
custom_preview_8 = CustomPreview(Geometry=[_3dchart.graphMesh, _3dchart.graphCurves, _3dchart.legend], Shader=ColourSwatch(SwatchColor=RGB(0, 0, 0)))

# ----
# Luftfeuchtigkeit
cluster_7 = Cluster()

# ----
# HINWEIS: LOW BOUND - Definiert den untersten Wert
# High BOUND - Definiert den höchsten Wert
# SEGMENTS - Definiert die Anzahl der Unterteilungen (Hier immer die gewünschte Anzahl + 1)
gradient_3 = Gradient(
    LowerLimit=0,
    UpperLimit=1,
    Parameter=cluster_7,
    stops=[0.135: RGB(255, 255, 255), 0.337: RGB(191, 217, 255), 0.545: RGB(153, 194, 255), 0.743: RGB(109, 101, 252), 1: RGB(13, 0, 255)])
low_bound_3 = Panel("20")
high_bound_3 = Panel("100")
segments_3 = Panel("11")

cluster_8 = Cluster_2(lowbound=low_bound_3, highbound=high_bound_3, numsegments=segments_3, customcolors=gradient_3)  # -> koordinaten_2, legendpar_2, panel, panel_2, panel_3

_3dchart_2 = Ladybug_3DChart(
    inputData=flatten(importepw.relativeHumidity),
    basePoint=cluster_8.koordinaten_2,
    xScale=cluster_8.panel_2,
    yScale=cluster_8.panel_3,
    zScale=cluster_8.panel,
    legendPar=cluster_8.legendpar_2)  # -> readMe, graphMesh, graphCurves, legend, legendBasePts, title, titleBasePts, dataPts, conditionalHOY; disabled; plug-in component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
custom_preview_9 = CustomPreview(
    Geometry=[_3dchart_2.graphMesh, _3dchart_2.graphCurves, _3dchart_2.legend],
    Shader=ColourSwatch(SwatchColor=RGB(0, 0, 0)))

preview_3 = CustomPreview(Geometry=crv, Shader=barchart.dataCrvColors)

# ---- group: visualise monthly mean min-max temp area
flip = FlipMatrix(Data=crv)
item_3 = ListItem(List=flip, Index=0, Wrap=True)
item_4 = ListItem(List=flip, Index=Slider(1, range=0..2), Wrap=True)
loft = Loft(
    Curves=[item_4, item_3],
    Options={Adjust=False, Closed=False, LoftEnds=0, LoftSimp=0, LoftType=0, Rebuild=10, Refit=0.01})  # -> simplify(flatten(Loft))
join = BrepJoin(Breps=loft)  # -> Breps, Closed

# ----
mesh_4 = MeshBrep(
    Brep=join.Breps,
    Settings={GridMaxCount=0, GridMinCount=16, JaggedSeams=False, MaxEdgeLength=0, MinEdgeLength=0.0001, MinTolerance=0, Refine=True, RefineAngle=0, RelativeTolerance=0.65, SimplePlanes=True, Tolerance=0})

# ---- group: visualise monthly mean min-max temp area (continued)
preview_4 = CustomPreview(Geometry=mesh_4, Shader=ColourSwatch(SwatchColor=RGBA(255, 217, 122, 92)))

# ==== cluster Cluster
series = Series(Start=0, Step="0.1", Count=10)
S = ClusterOutput(series)

# ==== cluster Cluster_2
lowbound = ClusterInput()
highbound = ClusterInput()
numsegments = ClusterInput()
customcolors = ClusterInput()
koordinaten = Panel("100,-20,0")
legendpar = Ladybug_LegendParameters(lowBound=lowbound, highBound=highbound, numSegments=numsegments, customColors=flatten(customcolors))  # -> legendPar; plug-in component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
panel = ClusterOutput("0")
panel_2 = ClusterOutput("0.025")
koordinaten_2 = ClusterOutput(koordinaten)
panel_3 = ClusterOutput("0.075")
legendpar_2 = ClusterOutput(legendpar)

# ==== cluster Cluster_3
lowbound = ClusterInput()
highbound = ClusterInput()
numsegments = ClusterInput()
customcolors = ClusterInput()
legendpar = Ladybug_LegendParameters(lowBound=lowbound, highBound=highbound, numSegments=numsegments, customColors=flatten(customcolors))  # -> legendPar; plug-in component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
panel = ClusterOutput("0.025")
panel_2 = ClusterOutput("0.075")
koordinaten = Panel("100,10,0")
legendpar_2 = ClusterOutput(legendpar)
panel_3 = ClusterOutput("0")
koordinaten_2 = ClusterOutput(koordinaten)

# ==== cluster Cluster_4
lowbound = ClusterInput()
highbound = ClusterInput()
numsegments = ClusterInput()
customcolors = ClusterInput()
legendpar = Ladybug_LegendParameters(lowBound=lowbound, highBound=highbound, numSegments=numsegments, customColors=flatten(customcolors))  # -> legendPar; plug-in component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
scale = Panel("0.15")
koordinaten = Panel("0,0,0")
legendpar_2 = ClusterOutput(legendpar)
koordinaten_2 = ClusterOutput(koordinaten)
scale_2 = ClusterOutput(scale)
boolean_toggle = ClusterOutput(Toggle(True))

# ==== cluster Cluster_5
pmvcomfortpar = Ladybug_PMVComfortParameters(humidRatioUpBound="0.014", humidRatioLowBound="0.004")  # -> comfortPar; plug-in component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
comfortpar = ClusterOutput(pmvcomfortpar)
koordinates = Panel("125,40,0")
scale = Panel("1.25")
koordinates_2 = ClusterOutput(koordinates)
scale_2 = ClusterOutput(scale)
boolean_toggle = ClusterOutput(Toggle(True))

# ==== cluster Cluster_6
koordinaten = Panel("85,120,0")
koordinaten_2 = ClusterOutput(koordinaten)
panel = ClusterOutput("1.5")
